# Grasshopper definition RhinoInsideUnity2.gh (Grasshopper 1.0.7)
# plug-ins: Kangaroo2 Components

pt = Point(Point(0, 5, 0))

# ---- group: test target point 2
pt_2 = Point(Point(0, 2.684986112, 0))

# ----
pt_3 = Point(Point(0, 0, 0))

# ---- group: test target point 1
pt_4 = Point(Point(0, 0, 0))

# ----
ln = Line(StartPoint=pt_3, EndPoint=pt)
receive = CSharpScript()  # -> x1_out, y1_out, z1_out, x2_out, y2_out, z2_out
# ---------- receive: C# ----------
    Register(Component);

    // Output the received x, y, and z coordinates
    x1_out = x1;
    y1_out = y1;
    z1_out = z1;
    x2_out = x2;
    y2_out = y2;
    z2_out = z2;
# ---------- receive: C# additional code ----------
  double x1 = 0.0;
  double y1 = 0.0;
  double z1 = 0.0;
  double x2 = 0.0;
  double y2 = 0.0;
  double z2 = 0.0;
  bool registered = false;
  IGH_Component comp = null;

  void Register(IGH_Component component)
  {
    if(!registered)
    {
      Rhino.Runtime.HostUtils.RegisterNamedCallback("ToGrasshopper", ToGrasshopper);

      comp = component;

      registered = true;
    }
  }

  void ToGrasshopper(object sender, Rhino.Runtime.NamedParametersEventArgs args)
  {
    // Retrieve x, y, and z coordinates from Unity
    double val;
    if (args.TryGetDouble("X1", out val))
      x1 = val;
    if (args.TryGetDouble("Y1", out val))
      y1 = val;
    if (args.TryGetDouble("Z1", out val))
      z1 = val;
    if (args.TryGetDouble("X2", out val))
      x2 = val;
    if (args.TryGetDouble("Y2", out val))
      y2 = val;
    if (args.TryGetDouble("Z2", out val))
      z2 = val;


    comp.ExpireSolution(true);
  }
# ---------- end receive ----------
divide = DivideCurve(Curve=ln, Count=10, Kinks=False)  # -> Points, Tangents, Parameters
python = GhPythonScript(x_input=receive.x1_out, y_input=receive.z1_out, z_input=receive.y1_out)  # -> out, output_point
# ---------- python: Python ----------
__author__ = "nikik"
__version__ = "2024.05.24"

import Rhino.Geometry as rg

# Convert input strings to numbers and create a Point3d
try:
    x = float(x_input)
    y = float(y_input)
    z = float(z_input)
    output_point = rg.Point3d(x, y, z)
except ValueError:
    output_point = None
# ---------- end python ----------
python_2 = GhPythonScript(x_input=receive.x2_out, y_input=receive.z2_out, z_input=receive.y2_out)  # -> out, output_point; same code as python
pline = PolyLine(Vertices=divide.Points, Closed=False)
len = Length(Curve=pline)

# ---- group: Point1
pt_5 = Point(python.output_point)

# ---- group: Point2
pt_6 = Point(python_2.output_point)

# ----
panel = Panel(pt_5)
panel_2 = Panel(pt_6)
end = EndPoints(Curve=pline)  # -> Start, End
anchor = Anchor(Point=end.Start, Target=pt_5, Strength=10000)
rod = Rod(Polyline=pline, LengthFactor="1", AngleFactor=1, AxialStrength=10, BendStrength=1)
load = Load(Point=divide.Points, ForceVector=Vector(0, 0, 1), Weighting="0.001")
length_line = LengthLine(Line=pline, Length="1", Strength=10)
anchor_2 = Anchor(Point=end.End, Target=pt_6, Strength=10000)
merge = Merge(Data1=anchor, Data2=anchor_2, Data3=load, Data4=length_line, Data5=rod)
solver = Solver(GoalObjects=merge, Reset=Button(), Threshold=1e-15, Tolerance=0.0001, On=Toggle(True))  # -> I, V, flatten(O)
clean = CleanTree(RemoveNulls=True, RemoveInvalid=True, RemoveEmpty=True, Tree=solver.O)
cull_i = CullIndex(List=clean, Indices=Slider(0, range=0..100), Wrap=True)
join = JoinCurves(Curves=cull_i, Preserve=False)
len_2 = Length(Curve=join)
pipe = Pipe(Curve=join, Radius=Slider(0.002, range=0..0.01), Caps=0)
mesh = MeshBrep(
    Brep=pipe,
    Settings={GridMaxCount=0, GridMinCount=16, JaggedSeams=False, MaxEdgeLength=0, MinEdgeLength=0.0001, MinTolerance=0, Refine=True, RefineAngle=0, RelativeTolerance=0.65, SimplePlanes=True, Tolerance=0})  # -> flatten(Mesh)
flatten = FlattenTree(Tree=mesh, Path="{0}")
graft = GraftTree(Tree=flatten, IncludeEmptyLists=True, IncludeNullItems=True)
mcol = MeshColours(Mesh=graft, Colours=ColourSwatch(SwatchColor=RGB(21, 255, 0)))
mjoin = MeshJoin(Meshes=flatten(mcol))
filter = StreamFilter(Gate=Slider(1, range=0..1), Stream0=mcol, Stream1=mjoin)  # -> flatten(Stream)
demesh = DeconstructMesh(Mesh=filter)  # -> Vertices, Faces, Colours, Normals
c_script = CSharpScript(mesh=filter)  # inputs mesh: list of Mesh
# ---------- c_script: C# usings ----------
using System.Linq;
# ---------- c_script: C# ----------
    using(var args = new Rhino.Runtime.NamedParametersEventArgs())
    {
      args.Set("mesh", mesh.ToArray());
      Rhino.Runtime.HostUtils.ExecuteNamedCallback("Unity:FromGrasshopper", args);
    }
# ---------- end c_script ----------
